# Dynamo graph Determine Panel dimensions Rev.00 - withOutElement ID.dyn (Dynamo 3.3.0.6316)
# packages: DynamoUnfold 1.0.1

categories = Categories("OST_CurtainWallPanels")  # graph input
all_elements_of_category = ElementsOfCategory(Category=categories)
watch = Watch(all_elements_of_category)
# note: From LunchBox
geometry = Element.Geometry(element=watch)

# group: Unfold
faces = Topology.Faces(topology=geometry)
boolean = BoolSelector(false)  # graph input
clean = List.Clean(list=faces, preserveIndices=boolean)
select_desire_panels_to_be = CodeBlock { 0; }  # "Select Desire Panels to be unfold"
getItemAtIndex = List.GetItemAtIndex(index=select_desire_panels_to_be)  # unwired: list
map = List.Map(list=clean, function=getItemAtIndex)
identity = CoordinateSystem.Identity()
XAxis = Vector.XAxis()
distance_between_each_panels = DoubleSlider(20, range=0..2500 step 0.1)  # graph input
labels_size = CodeBlock { 0.5; }

surfaceGeometry = Face.SurfaceGeometry(face=clean)
area = Surface.Area(surface=surfaceGeometry)
sortIndexByValue = List.SortIndexByValue(list=area)
lastItem = List.LastItem(list=sortIndexByValue@L2, lacing=Longest)

# group (continued): Unfold
getItemAtIndex_2 = List.GetItemAtIndex(list=map, index=lastItem, lacing=Longest)
surfaceGeometry_2 = Face.SurfaceGeometry(face=getItemAtIndex_2)
coordinateSystemAtParameter = Surface.CoordinateSystemAtParameter(surface=surfaceGeometry_2)
transform = Geometry.Transform(geometry=surfaceGeometry_2, fromCoordinateSystem=coordinateSystemAtParameter, contextCoordinateSystem=identity)
count = List.Count(list=transform)
code_block = CodeBlock(itemsTobeTranslate=count, Distance=distance_between_each_panels) { 5..#itemsTobeTranslate..Distance; }
translate = Geometry.Translate(geometry=transform, direction=XAxis, distance=code_block)
# note: DynamoUnfold
unfoldListOfSurfaces_AndReturnTransforms = DynamoUnfold.Unfolding.UnfoldListOfSurfaces_AndReturnTransforms(surfaces=translate)
generateUnfoldedLabels = DynamoUnfold.Unfolding.GenerateUnfoldedLabels(unfoldingObject=unfoldListOfSurfaces_AndReturnTransforms.unfoldingObject, labelScale=labels_size)
unfoldListOfSurfaces_AndReturnTransforms_2 = DynamoUnfold.Unfolding.UnfoldListOfSurfaces_AndReturnTransforms(surfaces=surfaceGeometry_2, lacing=Longest)
generateInitialLabels = DynamoUnfold.Unfolding.GenerateInitialLabels(unfoldingObject=unfoldListOfSurfaces_AndReturnTransforms_2.unfoldingObject, labelScale=labels_size, lacing=Longest)
flatten = List.Flatten(list=generateInitialLabels)

# group: Curves to ModelLine
perimeterCurves = Surface.PerimeterCurves(surface=translate)

# group: ModelCurve To Revit
byCurve = ModelCurve.ByCurve(curve=perimeterCurves)

count_2 = List.Count(list=surfaceGeometry_2)

# group: Length
length = Curve.Length()  # unwired: curve
watch_2 = Watch(length)
code_block_2 = CodeBlock { 2; }
flatten_2 = List.Flatten(list=watch_2, amount=code_block_2)

# group: Items
count_3 = List.Count()  # unwired: list
map_2 = List.Map(list=watch_2, function=count_3)
ofRepeatedItem = List.OfRepeatedItem(item=count_2, amount=map_2, lacing=Longest)
flatten_3 = List.Flatten(list=ofRepeatedItem)
watch_3 = Watch(flatten_3)

code_block_3 = CodeBlock { 1; }
sub = count_2 - code_block_3
getItemAtIndex_3 = List.GetItemAtIndex(list=watch, index=sub)

# group: Description
string_from_object = FromObject(object=getItemAtIndex_3)
count_4 = List.Count()  # unwired: list
map_3 = List.Map(list=watch_2, function=count_4)
ofRepeatedItem_2 = List.OfRepeatedItem(item=string_from_object, amount=map_3, lacing=Longest)
code_block_4 = CodeBlock { 2; }
flatten_4 = List.Flatten(list=ofRepeatedItem_2, amount=code_block_4)

byJoinedCurves = PolyCurve.ByJoinedCurves(curves=perimeterCurves)
length_2 = Curve.Length(curve=byJoinedCurves)

# group: Mark
count_5 = List.Count()  # unwired: list
map_4 = List.Map(list=watch_2, function=count_5)
ofRepeatedItem_3 = List.OfRepeatedItem(item=getItemAtIndex_3, amount=map_4, lacing=Longest)
flatten_5 = List.Flatten(list=ofRepeatedItem_3)
code_block_5 = CodeBlock { ["Mark"]; }
getParameterValueByName = Element.GetParameterValueByName(element=flatten_5, parameterName=code_block_5, lacing=CrossProduct)
flatten_6 = List.Flatten(list=getParameterValueByName)

# group: Total Length
code_block_6 = CodeBlock { ""; }
code_block_7 = CodeBlock(x=map_4) { x-1; }
ofRepeatedItem_4 = List.OfRepeatedItem(item=code_block_6, amount=code_block_7, lacing=Longest)
code_block_8 = CodeBlock { 1; }
flatten_7 = List.Flatten(list=ofRepeatedItem_4, amount=code_block_8)
addItemToEnd = List.AddItemToEnd(item=length_2, list=flatten_7, lacing=Longest)
flatten_8 = List.Flatten(list=addItemToEnd)

# group: Surface.Area
area_2 = Surface.Area(surface=surfaceGeometry_2)
code_block_9 = CodeBlock(x=area_2) { x/1000000; }
code_block_10 = CodeBlock { ""; }
code_block_11 = CodeBlock(x=map_4) { x-1; }
ofRepeatedItem_5 = List.OfRepeatedItem(item=code_block_10, amount=code_block_11, lacing=Longest)
code_block_12 = CodeBlock { 1; }
flatten_9 = List.Flatten(list=ofRepeatedItem_5, amount=code_block_12)
addItemToEnd_2 = List.AddItemToEnd(item=code_block_9, list=flatten_9, lacing=Longest)
flatten_10 = List.Flatten(list=addItemToEnd_2)

# group: Location
watch_4 = Watch()  # unwired: arg0
string_from_object_2 = FromObject(object=watch_4)
code_block_13 = CodeBlock { 0; 6; }
remove = String.Remove(string=string_from_object_2, startIndex=code_block_13.out0, count=code_block_13.out1)
string_from_object_3 = FromObject(object=remove)
length_3 = String.Length(string=string_from_object_3)
code_block_14 = CodeBlock(x=length_3) { x-1; }
substring = String.Substring(string=remove, startIndex=code_block_13.out0, length=code_block_14)
flatten_11 = List.Flatten(list=substring)
watch_5 = Watch(flatten_11)

# group: To Excel
create = List.Create(item0=watch_3, item1=flatten_4, item2=flatten_2, item3=flatten_8, item4=flatten_10, item5=watch_5, item6=flatten_6)
transpose = List.Transpose(lists=create)
string = StringInput("\"C:\\Users\\namaa\\Desktop\\New Microsoft Excel Worksheet.xlsx\"")  # graph input
code_block_15 = CodeBlock { "Sheet1"; 1; 0; }
exportToExcel = Data.ExportToExcel(filePath=string, sheetName=code_block_15.out0, startRow=code_block_15.out1, startColumn=code_block_15.out2)  # unwired: data

# group: 3D Annotation on Base Surface
code_block_16 = CodeBlock()
# ---------- code_block_16.designscript (2 lines) ----------
["3DName","On Plan view",
"On Elevation","TextSize"];
# ----------------------------------------
setParameterByName = Element.SetParameterByName(parameterName=code_block_16)  # unwired: element, value
family_types = FamilyTypes("System Panel:Aluminum Composite Panel 50 mm")  # graph input
code_block_17 = CodeBlock { 0.5; }
pointAtParameter = Surface.PointAtParameter(surface=translate, u=code_block_17, v=code_block_17)
byPoint = FamilyInstance.ByPoint(familyType=family_types, point=pointAtParameter)
string_from_object_4 = FromObject(object=getItemAtIndex_2)
code_block_18 = CodeBlock { 0; 1; 50; }
count_6 = List.Count(list=byPoint)
ofRepeatedItem_6 = List.OfRepeatedItem(item=code_block_18.out0, amount=count_6, lacing=Longest)
ofRepeatedItem_7 = List.OfRepeatedItem(item=code_block_18.out1, amount=count_6)
ofRepeatedItem_8 = List.OfRepeatedItem(item=code_block_18.out2, amount=count_6)
code_block_19 = CodeBlock(a=string_from_object_4, b=ofRepeatedItem_6, c=ofRepeatedItem_7, d=ofRepeatedItem_8) { [a,b,c,d]; }
transpose_2 = List.Transpose(lists=code_block_19)
combine = List.Combine(combineFunction=setParameterByName, list0=byPoint, list1=transpose_2)

flatten_12 = List.Flatten(list=combine)

# group (continued): 3D Annotation on Base Surface
code_block_20 = CodeBlock(num=flatten_12)
# ---------- code_block_20.designscript (11 lines) ----------
r=Color.ByARGB(255,255,0,0);
o=Color.ByARGB(255,255,128,0);
y=Color.ByARGB(255,255,255,0);
g=Color.ByARGB(255,0,255,0);
b=Color.ByARGB(255,0,128,255);
i=Color.ByARGB(255,0,0,255);
v=Color.ByARGB(255,127,0,255);
colors=[r,o,y,g,b,i,v];
0..1..#7;
a=List.Count(num);
0..1..#a;
# ----------------------------------------

color_range = ColorRange(colors=code_block_20.colors, indices=code_block_20.out8, value=code_block_20.out10)

# group: 3D Annotation
overrideColorInView = Element.OverrideColorInView(element=flatten_12, color=color_range)

# group: 3D Annotation
overrideColorInView_2 = Element.OverrideColorInView(color=color_range)  # unwired: element

# group: 3D Annotation on Unfolded Surface
code_block_21 = CodeBlock()  # same code as code_block_16
setParameterByName_2 = Element.SetParameterByName(parameterName=code_block_21)  # unwired: element, value
family_types_2 = FamilyTypes("System Panel:Aluminum Composite Panel 50 mm")  # graph input
code_block_22 = CodeBlock { 0.5; }
pointAtParameter_2 = Surface.PointAtParameter(surface=translate, u=code_block_22, v=code_block_22)
byPoint_2 = FamilyInstance.ByPoint(familyType=family_types_2, point=pointAtParameter_2)
string_from_object_5 = FromObject(object=getItemAtIndex_2)
code_block_23 = CodeBlock { 1; 0; 50; }
count_7 = List.Count(list=byPoint_2)
ofRepeatedItem_9 = List.OfRepeatedItem(item=code_block_23.out0, amount=count_7)
ofRepeatedItem_10 = List.OfRepeatedItem(item=code_block_23.out1, amount=count_7)
ofRepeatedItem_11 = List.OfRepeatedItem(item=code_block_23.out2, amount=count_7)
code_block_24 = CodeBlock(a=string_from_object_5, b=ofRepeatedItem_9, c=ofRepeatedItem_10, d=ofRepeatedItem_11) { [a,b,c,d]; }
transpose_3 = List.Transpose(lists=code_block_24)
combine_2 = List.Combine(combineFunction=setParameterByName_2, list0=byPoint_2, list1=transpose_3)

flatten_13 = List.Flatten(list=combine_2)

# group: Labels on Unflod Surface
byCurve_2 = ModelCurve.ByCurve()  # unwired: curve

flatten_14 = List.Flatten(list=generateUnfoldedLabels)

# group: Labels on Base Surface
byCurve_3 = ModelCurve.ByCurve(curve=flatten)

# group: Select Curtain Panels
select_model_elements = DSModelElementsSelection()  # 26 picked in the model; graph input
watch_6 = Watch(select_model_elements)
flatten_15 = List.Flatten(list=watch_6)
string_from_object_6 = FromObject()  # unwired: object
code_block_25 = CodeBlock(a=watch_6) { a[1]; }
string_from_object_7 = FromObject(object=code_block_25)
boolean_2 = BoolSelector(false)  # graph input
contains = String.Contains(searchFor=string_from_object_7, ignoreCase=boolean_2)  # unwired: string
compose = ComposeFunctions(function0=string_from_object_6, function1=contains)  # "Function.Compose"
filter = List.Filter(list=flatten_15, condition=compose)
match = Watch(filter.in)

unfoldListOfFaces_AndReturnTransforms = DynamoUnfold.Unfolding.UnfoldListOfFaces_AndReturnTransforms()  # unwired: faces
