# Dynamo graph Determine Panel dimensions newest and fullest.dyn (Dynamo 3.3.0.6316)
# packages: DynamoUnfold 1.0.1, Dimension Detail Line 0.0.1, archi-lab.net 2025.300.1225

# group: Select Curtain Panels
select_model_elements = DSModelElementsSelection()  # 25 picked in the model; graph input
watch = Watch(select_model_elements)
flatten = List.Flatten(list=watch)
string_from_object = FromObject()  # unwired: object
code_block = CodeBlock(a=watch) { a[1]; }
string_from_object_2 = FromObject(object=code_block)
boolean = BoolSelector(false)
contains = String.Contains(searchFor=string_from_object_2, ignoreCase=boolean)  # unwired: string
compose = ComposeFunctions(function0=string_from_object, function1=contains)  # "Function.Compose"
filter = List.Filter(list=flatten, condition=compose)
match = Watch(filter.in)

# group: Unfold
faces = Element.Faces(element=match)
identity = CoordinateSystem.Identity()
XAxis = Vector.XAxis()
distance_from_origin_x_axis = DoubleSlider(100, range=0..2500 step 0.1)  # graph input
distance_between_each_panels = DoubleSlider(20, range=0..2500 step 0.1)  # graph input
YAxis = Vector.YAxis()
distance_from_origin_y_axis = DoubleSlider(100, range=0..2500 step 0.1)  # graph input
# note: DynamoUnfold
labels_size = CodeBlock { 0.5; }

# group: Unfold > Maximum area
area = Surface.Area(surface=faces)
maximumItem = List.MaximumItem()  # unwired: list
map = List.Map(list=area, function=maximumItem)
indexOf = List.IndexOf(list=area, element=map, lacing=Longest)

# group (continued): Unfold
getItemAtIndex = List.GetItemAtIndex(list=faces, index=indexOf, lacing=Longest)
coordinateSystemAtParameter = Surface.CoordinateSystemAtParameter(surface=getItemAtIndex)
transform = Geometry.Transform(geometry=getItemAtIndex, fromCoordinateSystem=coordinateSystemAtParameter, contextCoordinateSystem=identity)
count = List.Count(list=transform)
code_block_2 = CodeBlock(Distancefromorigin=distance_from_origin_x_axis, itemsTobeTranslate=count, Distance=distance_between_each_panels) { Distancefromorigin..#itemsTobeTranslate..Distance; }
translate = Geometry.Translate(geometry=transform, direction=XAxis, distance=code_block_2)
translate_2 = Geometry.Translate(geometry=translate, direction=YAxis, distance=distance_from_origin_y_axis)
unfoldListOfSurfaces_AndReturnTransforms = DynamoUnfold.Unfolding.UnfoldListOfSurfaces_AndReturnTransforms(surfaces=translate_2)
generateUnfoldedLabels = DynamoUnfold.Unfolding.GenerateUnfoldedLabels(unfoldingObject=unfoldListOfSurfaces_AndReturnTransforms.unfoldingObject, labelScale=labels_size)  # frozen
flatten_2 = List.Flatten(list=generateUnfoldedLabels)

perimeterCurves = Surface.PerimeterCurves(surface=unfoldListOfSurfaces_AndReturnTransforms.surfaces)
byJoinedCurves = PolyCurve.ByJoinedCurves(curves=perimeterCurves)
code_block_3 = CodeBlock { 0.02; }
offsetMany = Curve.OffsetMany(curve=byJoinedCurves, signedDistance=code_block_3)
explode = Geometry.Explode(geometry=offsetMany)
byJoinedCurves_2 = PolyCurve.ByJoinedCurves(curves=explode)
code_block_4 = CodeBlock { 0; }
count_2 = List.Count(list=match)
code_block_5 = CodeBlock { 1; }
sub = count_2 - code_block_5
range = Range(start=code_block_4, end=sub, step=code_block_5)
getItemAtIndex_2 = List.GetItemAtIndex(list=match, index=range)
code_block_6 = CodeBlock(a=watch) { a[0]; }
code_block_7 = CodeBlock { "Mark"; }
getParameterValueByName = Element.GetParameterValueByName(element=code_block_6, parameterName=code_block_7)
prefix = CodeBlock(a=getParameterValueByName) { a+" "; }
code_block_8 = CodeBlock(x=prefix, y=range) { x+y; }

# group: 3D Annotation on Base Surface > 3D Annotation on Unfolded Surface
code_block_9 = CodeBlock { ["3DName","TextSize","Depth"]; }
setParameterByName = Element.SetParameterByName(parameterName=code_block_9)  # unwired: element, value
family_types = FamilyTypes("3DName Facebased:3DName Facebased")  # graph input
code_block_10 = CodeBlock { 0.5; }
pointAtParameter = Surface.PointAtParameter(surface=translate_2, u=code_block_10, v=code_block_10)
byPoint = FamilyInstance.ByPoint(familyType=family_types, point=pointAtParameter)
string_from_object_3 = FromObject(object=code_block_8)
code_block_11 = CodeBlock { 0.1; 0.1; }
count_3 = List.Count(list=byPoint)
ofRepeatedItem = List.OfRepeatedItem(item=code_block_11.out0, amount=count_3)
ofRepeatedItem_2 = List.OfRepeatedItem(item=code_block_11.out1, amount=count_3)
code_block_12 = CodeBlock(a=string_from_object_3, b=ofRepeatedItem, c=ofRepeatedItem_2) { [a,b,c]; }
transpose = List.Transpose(lists=code_block_12)
combine = List.Combine(combineFunction=setParameterByName, list0=byPoint, list1=transpose)

flatten_3 = List.Flatten(list=combine)

# group: 3D Annotation on Base Surface
code_block_13 = CodeBlock { ["3DName","TextSize","Depth"]; }
setParameterByName_2 = Element.SetParameterByName(parameterName=code_block_13)  # unwired: element, value
family_types_2 = FamilyTypes("3DName Facebased:3DName Facebased")  # graph input
getCentroid = archilab.Revit.Elements.Elements.GetCentroid(element=match)
code_block_14 = CodeBlock { 0.5; }
string_from_object_4 = FromObject(object=code_block_8)
code_block_15 = CodeBlock { 0.1; 0.1; }

normalAtParameter = Surface.NormalAtParameter(surface=getItemAtIndex, u=code_block_14, v=code_block_14)
coordinateSystemAtParameter_2 = Surface.CoordinateSystemAtParameter(surface=getItemAtIndex, u=code_block_14, v=code_block_14)
XAxis_2 = CoordinateSystem.XAxis(coordinateSystem=coordinateSystemAtParameter_2)
code_block_16 = CodeBlock { 90; }
rotate = Vector.Rotate(vector=normalAtParameter, axis=XAxis_2, degrees=code_block_16)

# group (continued): 3D Annotation on Base Surface
byFace = FamilyInstance.ByFace(familyType=family_types_2, face=getItemAtIndex, location=getCentroid, referenceDirection=rotate)
count_4 = List.Count(list=byFace)
ofRepeatedItem_3 = List.OfRepeatedItem(item=code_block_15.out0, amount=count_4)
ofRepeatedItem_4 = List.OfRepeatedItem(item=code_block_15.out1, amount=count_4)
code_block_17 = CodeBlock(a=string_from_object_4, b=ofRepeatedItem_3, c=ofRepeatedItem_4) { [a,b,c]; }
transpose_2 = List.Transpose(lists=code_block_17)
combine_2 = List.Combine(combineFunction=setParameterByName_2, list0=byFace, list1=transpose_2)
flatten_4 = List.Flatten(list=combine_2)
code_block_18 = CodeBlock(num=flatten_4)
# ---------- code_block_18.designscript (11 lines) ----------
r=Color.ByARGB(255,255,0,0);
o=Color.ByARGB(255,255,128,0);
y=Color.ByARGB(255,255,255,0);
g=Color.ByARGB(255,0,255,0);
b=Color.ByARGB(255,0,128,255);
i=Color.ByARGB(255,0,0,255);
v=Color.ByARGB(255,127,0,255);
colors=[r,o,y,g,b,i,v];
0..1..#7;
a=List.Count(num);
0..1..#a;
# ----------------------------------------
color_range = ColorRange(colors=code_block_18.colors, indices=code_block_18.out8, value=code_block_18.out10)

# group: 3D Annotation
overrideColorInView = Element.OverrideColorInView(element=flatten_3, color=color_range)  # graph output

# group: Labels on Unflod Surface
byCurve = ModelCurve.ByCurve(curve=flatten_2)

# group: Labels on Base Surface
byCurve_2 = ModelCurve.ByCurve()  # unwired: curve

code_block_19 = CodeBlock { true; }
clean = List.Clean(list=getItemAtIndex, preserveIndices=code_block_19)

# group (continued): Unfold
unfoldListOfSurfaces_AndReturnTransforms_2 = DynamoUnfold.Unfolding.UnfoldListOfSurfaces_AndReturnTransforms(surfaces=clean)
flatten_5 = List.Flatten(list=unfoldListOfSurfaces_AndReturnTransforms_2.unfoldingObject)
generateInitialLabels = DynamoUnfold.Unfolding.GenerateInitialLabels(unfoldingObject=flatten_5, labelScale=labels_size)
flatten_6 = List.Flatten(list=generateInitialLabels)

length = Curve.Length(curve=byJoinedCurves_2)
flatten_7 = List.Flatten(list=length)
views = Views("05- Unwrapped A-N")  # graph input

# group: Curves to ModelLine
curves = PolyCurve.Curves(polyCurve=byJoinedCurves_2)
byCurve_3 = DetailCurve.ByCurve(view=views, curve=curves)
curve = DetailCurve.Curve(detailCurve=byCurve_3)  # graph output

# group: Length
length_2 = Curve.Length(curve=curves)
watch_2 = Watch(length_2)
code_block_20 = CodeBlock { 1; }
flatten_8 = List.Flatten(list=watch_2, amount=code_block_20)
code_block_21 = CodeBlock { 2; }
flatten_9 = List.Flatten(list=watch_2, amount=code_block_21)

# group: Items
count_5 = List.Count()  # unwired: list
map_2 = List.Map(list=flatten_8, function=count_5)
ofRepeatedItem_5 = List.OfRepeatedItem(item=range, amount=map_2, lacing=Longest)
flatten_10 = List.Flatten(list=ofRepeatedItem_5)
watch_3 = Watch(flatten_10)

# group: Items
string_from_object_5 = FromObject(object=match)
count_6 = List.Count()  # unwired: list
map_3 = List.Map(list=flatten_8, function=count_6)
ofRepeatedItem_6 = List.OfRepeatedItem(item=string_from_object_5, amount=map_3, lacing=Longest)
flatten_11 = List.Flatten(list=ofRepeatedItem_6)
watch_4 = Watch(flatten_11)

# group: Location
watch_5 = Watch(curve)
string_from_object_6 = FromObject(object=watch_5)
code_block_22 = CodeBlock { 0; 6; }
remove = String.Remove(string=string_from_object_6, startIndex=code_block_22.out0, count=code_block_22.out1)
string_from_object_7 = FromObject(object=remove)
length_3 = String.Length(string=string_from_object_7)
code_block_23 = CodeBlock(x=length_3) { x-1; }
substring = String.Substring(string=remove, startIndex=code_block_22.out0, length=code_block_23)
flatten_12 = List.Flatten(list=substring)
watch_6 = Watch(flatten_12)

code_block_24 = CodeBlock { ["Mark"]; }
setParameterByName_3 = Element.SetParameterByName(parameterName=code_block_24)  # unwired: element, value
combine_3 = List.Combine(combineFunction=setParameterByName_3, list0=match, list1=code_block_8)
flatten_13 = List.Flatten(list=combine_3)

# group: Mark
count_7 = List.Count()  # unwired: list
map_4 = List.Map(list=flatten_8, function=count_7)
ofRepeatedItem_7 = List.OfRepeatedItem(item=flatten_13, amount=map_4, lacing=Longest)
flatten_14 = List.Flatten(list=ofRepeatedItem_7)
code_block_25 = CodeBlock { ["Mark"]; }
getParameterValueByName_2 = Element.GetParameterValueByName(element=flatten_14, parameterName=code_block_25, lacing=CrossProduct)
flatten_15 = List.Flatten(list=getParameterValueByName_2)

# group: Total Length
code_block_26 = CodeBlock { ""; }
code_block_27 = CodeBlock(x=map_4) { x-1; }
ofRepeatedItem_8 = List.OfRepeatedItem(item=code_block_26, amount=code_block_27, lacing=Longest)
code_block_28 = CodeBlock { 1; }
flatten_16 = List.Flatten(list=ofRepeatedItem_8, amount=code_block_28)
addItemToEnd = List.AddItemToEnd(item=flatten_7, list=ofRepeatedItem_8, lacing=Longest)
flatten_17 = List.Flatten(list=addItemToEnd)

# group: Surface.Area
area_2 = Surface.Area(surface=getItemAtIndex)
addItemToEnd_2 = List.AddItemToEnd(item=area_2, list=ofRepeatedItem_8, lacing=Longest)
flatten_18 = List.Flatten(list=addItemToEnd_2)

# group: To Excel
string = StringInput("D:\REEMAT\REMATREVIT\")  # graph input
string_from_object_8 = FromObject(object=getParameterValueByName)
string_2 = StringInput(".xlsx")
code_block_29 = CodeBlock(a=string, b=string_from_object_8, c=string_2) { a+b+c; }
code_block_30 = CodeBlock { "Sheet1"; 1; 0; }
create = List.Create(item0=watch_3, item1=flatten_11, item2=flatten_9, item3=flatten_17, item4=flatten_18, item5=watch_6, item6=flatten_15)
transpose_3 = List.Transpose(lists=create)
exportToExcel = Data.ExportToExcel(filePath=code_block_29, sheetName=code_block_30.out0, startRow=code_block_30.out1, startColumn=code_block_30.out2, data=transpose_3)  # graph output

code_block_31 = CodeBlock { 1; }
range_2 = Range(start=code_block_31, end=count_2, step=code_block_5)

# group: 3D Annotation
overrideColorInView_2 = Element.OverrideColorInView(element=flatten_4, color=color_range)  # graph output

geometry = Element.Geometry(element=overrideColorInView_2)
contextCoordinateSystem = Geometry.ContextCoordinateSystem(geometry=geometry)
transform_2 = Geometry.Transform(geometry=geometry, fromCoordinateSystem=contextCoordinateSystem, contextCoordinateSystem=identity)

# group: dimensioning
offsetMany_2 = Curve.OffsetMany(curve=curves)
byCurve_4 = DetailCurve.ByCurve(view=views, curve=offsetMany_2)
flatten_19 = List.Flatten(list=byCurve_4)
dimension_detail_line = Custom[Dimension Detail Line](line=flatten_19, lacing=Longest)  # package Dimension Detail Line; Given Detail Line, pleace Dimension

perimeterCurves_2 = Surface.PerimeterCurves(surface=unfoldListOfSurfaces_AndReturnTransforms.surfaces)
byJoinedCurves_3 = PolyCurve.ByJoinedCurves(curves=perimeterCurves_2@L1)

# group: Curves to ModelLine
curves_2 = PolyCurve.Curves(polyCurve=byJoinedCurves_3)
byCurve_5 = DetailCurve.ByCurve(view=views, curve=curves_2)
curve_2 = DetailCurve.Curve(detailCurve=byCurve_5)  # graph output

code_block_32 = CodeBlock {  }
code_block_33 = CodeBlock { true; }
mergeUnfoldingObjects = DynamoUnfold.Unfolding.MergeUnfoldingObjects()  # unwired: unfoldings
